# Dynamo custom node OS_FacadeSection.dyf (Dynamo 2.12.0.5650)
# category: JNO

picked_points = Input(picked_points: var[]..[])
is_open_facade = Input(is_open_facade: var[]..[])
roof_level = Input(roof_level: var[]..[])
groundfloor_level = Input(groundfloor_level: var[]..[])
columntype_openfacade = Input(columntype_openfacade: var[]..[])
waltype_closedfacade = Input(waltype_closedfacade: var[]..[])
code_block = CodeBlock(picked_points=picked_points, is_open_facade=is_open_facade, roof_level=roof_level, groundfloor_level=groundfloor_level, columntype_openfacade=columntype_openfacade, waltype_closedfacade=waltype_closedfacade) { picked_points; is_open_facade; roof_level; groundfloor_level; columntype_openfacade; waltype_closedfacade; }

# group: build baseline from point input
# note: build pairs of points
# directly add a third point
# for refplane building
python_script = Python(IN[0]=code_block.picked_points)  # IronPython2
# ---------- python_script.python (22 lines) ----------
import clr
clr.AddReference('ProtoGeometry')
from Autodesk.DesignScript.Geometry import *

points = IN[0]
out = []

for p in points:
	i = points.index(p)
	if i == len(points) - 1:
		break
	
	# make a list of this point with the second point
	# and a vertically translated point
	# these will form the basis for a reference plane 
	
	zpoint = Geometry.Translate(p, Vector.ZAxis(), 1)
	
	out.append([p, points[i+1], zpoint])

OUT = out
	
# ----------------------------------------
code_block_2 = CodeBlock { 0; 1; 2; }
getItemAtIndex = List.GetItemAtIndex(list=python_script@L2, index=code_block_2.out2)
getItemAtIndex_2 = List.GetItemAtIndex(list=python_script@L2, index=code_block_2.out0)
getItemAtIndex_3 = List.GetItemAtIndex(list=python_script@L2, index=code_block_2.out1)
byStartPointEndPoint = Line.ByStartPointEndPoint(startPoint=getItemAtIndex_2, endPoint=getItemAtIndex_3)

item = Output(getItemAtIndex)
OS_PlacePanelsByLine = Custom[OS_PlacePanelsByLine](baselines=byStartPointEndPoint, roof_level=code_block.roof_level, is_open_facade=code_block.is_open_facade)
panels = Output(OS_PlacePanelsByLine)
run = Custom[Run](run=code_block.is_open_facade, stream=byStartPointEndPoint)  # Passes the stream if run==true, else returns null
# note: runs if open facade
OS_PlaceFacadeSteelColumns = Custom[OS_PlaceFacadeSteelColumns](baselines=run, roof_level=code_block.roof_level, ground_floor_level=code_block.groundfloor_level, column_family_type=code_block.columntype_openfacade)
FamilyInstance = Output(OS_PlaceFacadeSteelColumns)
not_ = Not(x=code_block.is_open_facade)
run_2 = Custom[Run](run=not_, stream=byStartPointEndPoint)
# note: runs if closed facade
OS_FacadeConcreteWall = Custom[OS_FacadeConcreteWall](roof_level=code_block.roof_level, baselines=run_2, wallType=code_block.waltype_closedfacade, groundfloor_level=code_block.groundfloor_level)
Output = Output(OS_FacadeConcreteWall.out0)  # ""
Wall = Output(OS_FacadeConcreteWall.Wall)
