# Dynamo custom node OS_PlaceDoor.dyf (Dynamo 2.12.0.5650)
# category: JNO
# packages: archi-lab.net 2023.213.1622, spring nodes 210.1.1, Sastrugi 2.0.2

gridlines_view = Input(gridlines_view: var[]..[])
is_double_door = Input(is_double_door: var[]..[])
door_height = Input(door_height: var[]..[])

# group: inputs
code_block = CodeBlock(view_containing_gridlines=gridlines_view, is_double_door=is_double_door, door_height=door_height) { view_containing_gridlines; is_double_door; door_height; }

# group: get grid detail lines
categories = Categories("OST_Lines")
all_elements_of_category_in_view = ElementsOfCategoryInView(Category=categories, View=code_block.view_containing_gridlines)
geometry = Element.Geometry(element=all_elements_of_category_in_view)

# group: get the grid intersection points
intersect = Geometry.Intersect(geometry=geometry, other=geometry, lacing=CrossProduct)
flatten = List.Flatten(list=intersect)
string_from_object = FromObject(object=flatten)
code_block_2 = CodeBlock { "Line"; }
contains = String.Contains(string=string_from_object, searchFor=code_block_2)
# note: filter away lines
filterByBoolMask = List.FilterByBoolMask(list=flatten, mask=contains)
code_block_3 = CodeBlock(points=filterByBoolMask.out) { points; }
pruneDuplicates = Point.PruneDuplicates(points=code_block_3)

# group: get the outer perimeter (convex hull) of the grid
ꟿ_points_convexhull2d = Custom[ꟿ Points.ConvexHull2D](points=pruneDuplicates)  # package spring nodes; Computes the XY convex hull of a given set of points based on the monotone chain algorithm.
code_block_4 = CodeBlock { true; }
byPoints = PolyCurve.ByPoints(points=ꟿ_points_convexhull2d, connectLastToFirst=code_block_4)

trigger_placement_point = Input(trigger_placement_point: bool = true)
pick_points_on_workplane = Custom[❄_Pick Points on Workplane](Reset=trigger_placement_point)  # package Sastrugi; (Sastrugi_Selection) This node allows users to pick points in Revit on the Active Workplane.

# group: get the clicked point on the building edge
closestPointTo = Geometry.ClosestPointTo(geometry=byPoints, other=pick_points_on_workplane.RevitPoints)

# group: get the 2 gridpoints left and right from the picked point
distanceTo = Geometry.DistanceTo(geometry=pruneDuplicates, other=closestPointTo, lacing=Longest)
sortByKey = List.SortByKey(list=pruneDuplicates, keys=distanceTo)
code_block_5 = CodeBlock(list=sortByKey.sortedList) { list; }
code_block_6 = CodeBlock(list=code_block_5) { list[0]; list[1]; }
code_block_7 = CodeBlock(keys=sortByKey.sortedKeys) { keys; }

code_block_8 = CodeBlock(door_heght=code_block.door_height) { door_heght; }
code_block_9 = CodeBlock(door_heght=code_block_8) { door_heght; }

# group: build a solid at the door position
byStartPointEndPoint = Line.ByStartPointEndPoint(startPoint=code_block_6.out0, endPoint=code_block_6.out1)
ZAxis = Vector.ZAxis()
code_block_10 = CodeBlock(door_height=code_block_9) { door_height; }
extrude = Curve.Extrude(curve=byStartPointEndPoint, direction=ZAxis, distance=code_block_10)
code_block_11 = CodeBlock { 1000; }
thicken = Surface.Thicken(surface=extrude, thickness=code_block_11)

# group: build a slightly smaller solid at the door position
code_block_12 = CodeBlock { -100; }
extendCurveStartEnd = Custom[ExtendCurveStartEnd](curve=byStartPointEndPoint, distance=code_block_12)
ZAxis_2 = Vector.ZAxis()
code_block_13 = CodeBlock(door_height=code_block_9) { door_height-50; }
extrude_2 = Curve.Extrude(curve=extendCurveStartEnd, direction=ZAxis_2, distance=code_block_13)
code_block_14 = CodeBlock { 1000; }
thicken_2 = Surface.Thicken(surface=extrude_2, thickness=code_block_14)

# group: get the intersecting panels
family_types = FamilyTypes("GM_Panel_Marco_Vermeulen:Closed")
all_elements_of_family_type = ElementsOfFamilyType(Family_Type=family_types)
family_types_2 = FamilyTypes("GM_Panel_Marco_Vermeulen:Rooster")
all_elements_of_family_type_2 = ElementsOfFamilyType(Family_Type=family_types_2)
code_block_15 = CodeBlock(a=all_elements_of_family_type, b=all_elements_of_family_type_2) { List.Flatten([a,b]); }
byGeometry = BoundingBox.ByGeometry(geom=thicken_2)
boundingBox = Element.BoundingBox(element=code_block_15)
intersects = BoundingBox.Intersects(boundingBox=byGeometry, other=boundingBox)
filterByBoolMask_2 = List.FilterByBoolMask(list=code_block_15, mask=intersects)
code_block_16 = CodeBlock(intersecting_panels=filterByBoolMask_2.in) { intersecting_panels; }

# group: delete the intersecting panels
delete = archilab.Revit.Elements.Elements.Delete(element=code_block_16)

# group: get the intersecting wall (should be 1 in case of a closed facade)
categories_2 = Categories("OST_Walls")
all_elements_of_category = ElementsOfCategory(Category=categories_2)
byGeometry_2 = BoundingBox.ByGeometry(geom=thicken)
boundingBox_2 = Element.BoundingBox(element=all_elements_of_category)
intersects_2 = BoundingBox.Intersects(boundingBox=byGeometry_2, other=boundingBox_2)
filterByBoolMask_3 = List.FilterByBoolMask(list=all_elements_of_category, mask=intersects_2)
code_block_17 = CodeBlock(intersecting_wall=filterByBoolMask_3.in) { intersecting_wall; }

# group: get point at exact centre (placement point for single door)
byStartPointEndPoint_2 = Line.ByStartPointEndPoint(startPoint=code_block_6.out0, endPoint=code_block_6.out1)
code_block_18 = CodeBlock { 0.5; }
pointAtParameter = Curve.PointAtParameter(curve=byStartPointEndPoint_2, param=code_block_18)

# group: place opening in wall (crashes)
family_types_3 = FamilyTypes("OS_Wall_Opening:OS_Wall_Opening")
ꟿ_familyinstance_byhostandpoint = Custom[ꟿ FamilyInstance.ByHostAndPoint](host=code_block_17, type=family_types_3)  # package spring nodes; Creates hosted family instances(doors/windows) at the specified points. You can feed either a single family type or a unique type for each instance.; unwired: point
getLocation = Element.GetLocation(element=code_block_17)
code_block_19 = CodeBlock(centerpoint=pointAtParameter) { centerpoint; }
# note: point at wall location curve
closestPointTo_2 = Geometry.ClosestPointTo(geometry=getLocation, other=code_block_19)

# group: place door
family_types_4 = FamilyTypes("RHD_Door_Unhosted_Single_JNO:Closed")
byPoint = FamilyInstance.ByPoint(familyType=family_types_4, point=pointAtParameter)

# group: get door rotation value
explode = Geometry.Explode(geometry=byPoints)
doesIntersect = Geometry.DoesIntersect(geometry=explode, other=pointAtParameter)
filterByBoolMask_4 = List.FilterByBoolMask(list=explode, mask=doesIntersect)
code_block_20 = CodeBlock(i=filterByBoolMask_4.in) { i; }
direction = Line.Direction(line=code_block_20)
XAxis = Vector.XAxis()
ZAxis_3 = Vector.ZAxis()
angleAboutAxis = Vector.AngleAboutAxis(vector=direction, otherVector=XAxis, rotationAxis=ZAxis_3)

# group: rotate door
setRotation = FamilyInstance.SetRotation(familyInstance=byPoint, degree=angleAboutAxis)

# group: set door height
code_block_21 = CodeBlock { "inst_height"; }
setParameterByName = Element.SetParameterByName(element=setRotation, parameterName=code_block_21, value=code_block_9)

Element = Output(setParameterByName)
