# Dynamo custom node OS_PlaceFacadeSteelColumns.dyf (Dynamo 2.12.0.5650)
# category: JNO

column_family_type = Input(column_family_type: var[]..[])  # script assumes a type of height 150
baselines = Input(baselines: var[]..[])

# group: turn the baselines into a polycurve
code_block = CodeBlock(baselines=baselines) { baselines; }
byJoinedCurves = PolyCurve.ByJoinedCurves(curves=code_block)

# group: fixed params
# note: outer_wall_concrete_thickness
number = DoubleInput(150)

# group: get base points for steel columns
# note: assumption: line is drawn counter clockwise. we need a negative direction
code_block_2 = CodeBlock(d=number) { d * -1; }
offset = Curve.Offset(curve=byJoinedCurves, distance=code_block_2)
startPoint = Curve.StartPoint(curve=byJoinedCurves)
code_block_3 = CodeBlock { 1200; }
pointsAtSegmentLengthFromPoint = Curve.PointsAtSegmentLengthFromPoint(curve=byJoinedCurves, point=startPoint, segmentLength=code_block_3)
endPoint = Curve.EndPoint(curve=byJoinedCurves)
code_block_4 = CodeBlock(startpt=startPoint, middlepts=pointsAtSegmentLengthFromPoint, endpt=endPoint) { [startpt, middlepts, endpt]; }
flatten = List.Flatten(list=code_block_4)
# note: points on grid
pruneDuplicates = Point.PruneDuplicates(points=flatten)
# note: offset placement points
closestPointTo = Geometry.ClosestPointTo(geometry=offset, other=pruneDuplicates)

ground_floor_level = Input(ground_floor_level: var[]..[])

# group: place the steel columns
byPointAndLevel = FamilyInstance.ByPointAndLevel(familyType=column_family_type, point=closestPointTo, level=ground_floor_level)

roof_level = Input(roof_level: var[]..[])
elevation = Level.Elevation(level=roof_level)
code_block_5 = CodeBlock(l=elevation) { l + 150; }

# group: set steel column height to match facade height
code_block_6 = CodeBlock(facade_height=code_block_5) { facade_height; }
levels = Levels("Roof")
code_block_7 = CodeBlock { "Elevation"; }
getParameterValueByName = Element.GetParameterValueByName(element=levels, parameterName=code_block_7)
code_block_8 = CodeBlock(facade_height=code_block_6, roof_level=getParameterValueByName) { "Top Offset"; facade_height - roof_level; }
setParameterByName = Element.SetParameterByName(element=byPointAndLevel, parameterName=code_block_8.out0, value=code_block_8.out1)

# group: rotate the steel columns
byTwoPoints = Vector.ByTwoPoints(start=pruneDuplicates, end=closestPointTo)
YAxis = Vector.YAxis()
angleWithVector = Vector.AngleWithVector(vector=byTwoPoints, otherVector=YAxis)
setRotation = FamilyInstance.SetRotation(familyInstance=byPointAndLevel, degree=angleWithVector)

FamilyInstance = Output(setRotation)
