# Dynamo custom node OS_PlacePanelsByLine.dyf (Dynamo 2.12.0.5650)
# category: JNO
# packages: Clockwork for Dynamo 2.x 2.4.0, archi-lab.net 2023.213.1622

baselines = Input(baselines: var[]..[])
roof_level = Input(roof_level: var[]..[])

# group: get facade top level
elevation = Level.Elevation(level=roof_level)
code_block = CodeBlock(l=elevation) { l + 150; }

code_block_2 = CodeBlock(baselines=baselines, facade_top_level=code_block) { baselines; facade_top_level; }

# group: create temporary referenceplane for panel placement
startPoint = Curve.StartPoint(curve=code_block_2.baselines)
endPoint = Curve.EndPoint(curve=code_block_2.baselines)
ZAxis = Vector.ZAxis()
# note: create ref plane through api
# Z vector down ensures normal pointing put
reverse = Vector.Reverse(vector=ZAxis)
testCreateRefPlane = Custom[TestCreateRefPlane](stpt=startPoint, endpt=endPoint, cutVec=reverse)

is_open_facade = Input(is_open_facade: bool)

# group: get the right panel type
family_types = FamilyTypes("GM_Panel_Marco_Vermeulen:Rooster")
family_types_2 = FamilyTypes("GM_Panel_Marco_Vermeulen:Closed")
if_ = RefactoredIf(test=is_open_facade, true=family_types, false=family_types_2)

# group: distribute points 1200 mm spaced along the input lines these points are the horizontal center of the panels
startPoint_2 = Curve.StartPoint(curve=code_block_2.baselines)
code_block_3 = CodeBlock { 600; }
pointsAtSegmentLengthFromPoint = Curve.PointsAtSegmentLengthFromPoint(curve=code_block_2.baselines, point=startPoint_2, segmentLength=code_block_3)
endPoint_2 = Curve.EndPoint(curve=code_block_2.baselines)
code_block_4 = CodeBlock(startpt=startPoint_2, middlepts=pointsAtSegmentLengthFromPoint, endpt=endPoint_2) { [startpt, middlepts, endpt]; }
transpose = List.Transpose(lists=code_block_4)
flatten = List.Flatten(list=transpose@L3)
pruneDuplicates = Point.PruneDuplicates(points=flatten)
code_block_5 = CodeBlock { 2; 1; }
dropEveryNthItem = List.DropEveryNthItem(list=pruneDuplicates@L2, n=code_block_5.out0, offset=code_block_5.out1)

# group: move facade panel points to top of facade then downward to get final placement points
ZAxis_2 = Vector.ZAxis()
translate = Geometry.Translate(geometry=dropEveryNthItem, direction=ZAxis_2, distance=code_block_2.facade_top_level)
ZAxis_3 = Vector.ZAxis()
reverse_2 = Vector.Reverse(vector=ZAxis_3)
code_block_6 = CodeBlock(facade_height=code_block_2.facade_top_level) { npanels = Math.Ceiling(facade_height / 1200); facade_height; 0; 1200; 1200 * npanels - 1; }
range = Range(start=code_block_6.out2, end=code_block_6.out4, step=code_block_6.out3)
translate_2 = Geometry.Translate(geometry=translate@L2, direction=reverse_2, distance=range, lacing=CrossProduct)
# note: a flat list per facade direction
flatten_2 = List.Flatten(list=translate_2@L3)

# group: create the panels
code_block_7 = CodeBlock(refplane=testCreateRefPlane) { refplane; }
direction = Line.Direction(line=code_block_2.baselines)
# note: is used my own API code here to prevent a bug that occurred with some double execution. it might be unnecessary. i made sure that output list composition is the same is the list structure of the input location points
python_script = Python(IN[0]=if_, IN[1]=code_block_7, IN[2]=flatten_2, IN[3]=direction)  # IronPython2
# ---------- python_script.python (45 lines) ----------
import clr
clr.AddReference('RevitNodes')
import Revit
clr.ImportExtensions(Revit.GeometryConversion)
from Revit.Elements import *
clr.AddReference('System')
from System.Collections.Generic import *
clr.AddReference('RevitAPI')
from Autodesk.Revit.DB import *
clr.AddReference('RevitServices')
import RevitServices
from RevitServices.Persistence import DocumentManager
from RevitServices.Transactions import TransactionManager

def BuildInstance(symbol, refPlane, location, referenceDirection, doc):
	symbol.Activate()
	reference = Reference(refPlane)
	new = doc.Create.NewFamilyInstance(reference,location.ToXyz(),referenceDirection.ToXyz(),symbol)
	return new

doc = DocumentManager.Instance.CurrentDBDocument
uiapp = DocumentManager.Instance.CurrentUIApplication
app = uiapp.Application

#The inputs to this node will be stored as a list in the IN variables.
symbol = UnwrapElement(IN[0])
refPlanes = UnwrapElement(IN[1])
pointgroups = UnwrapElement(IN[2])
referenceDirections = UnwrapElement(IN[3])
out = []

TransactionManager.Instance.EnsureInTransaction(doc)

for group in pointgroups:
	sublist = []
	i = pointgroups.IndexOf(group)
	for point in group:
		inst = BuildInstance(symbol, refPlanes[i], point, referenceDirections[i], doc)
		sublist.append(inst)
	out.append(sublist)

TransactionManager.Instance.TransactionTaskDone()

#Assign your output to the OUT variable.
OUT = out
# ----------------------------------------

# group: change height of lowest panels
location = FamilyInstance.Location(familyInstance=python_script)
Z = Point.Z(point=location)
code_block_8 = CodeBlock(a=Z) { a < 1200; }
filterByBoolMask = List.FilterByBoolMask(list=python_script, mask=code_block_8)
code_block_9 = CodeBlock(lowest_panels=filterByBoolMask.in) { lowest_panels; }
code_block_10 = CodeBlock { "panel_height"; }
code_block_11 = CodeBlock(facade_height=code_block_6.facade_height, npanels=code_block_6.npanels) { restmaat = facade_height - npanels * 1200 + 1200; }
setParameterByName = Element.SetParameterByName(element=code_block_9, parameterName=code_block_10, value=code_block_11)

# group: delete the reference planes
passthrough = Custom[Passthrough](passThrough=code_block_7, waitFor=setParameterByName)  # package Clockwork for Dynamo 2.x; Forces a sequential order of execution. The node wired into the output of the Passthrough node will be executed *after* the node wired into the waitFor input (e.g. important for some Revit operations). The value of the passThrough input will be passed on to the node wired into the output port of the Passthrough node.
delete = archilab.Revit.Elements.Elements.Delete(element=passthrough)

panels = Output(python_script)
