# Dynamo custom node OS_FacadeConcreteWall.dyf (Dynamo 2.12.0.5650)
# category: JNO

roof_level = Input(roof_level: var[]..[])
baselines = Input(baselines: var[]..[])
wallType = Input(wallType: var[]..[])

# group: offset basecurve towards wall centre line
byJoinedCurves = PolyCurve.ByJoinedCurves(curves=baselines)
width = WallType.Width(wallType=wallType)
convert_between_units = DynamoConvert(width, MeasurementType="Length", FromConversion="Feet", ToConversion="Millimeters")
code_block = CodeBlock(wallThickness=convert_between_units) { (150 + (wallThickness / 2)) * -1; }
offset = Curve.Offset(curve=byJoinedCurves, distance=code_block)

groundfloor_level = Input(groundfloor_level: var[]..[])

# group: create the wall with the proper height
code_block_2 = CodeBlock { "Elevation"; }
getParameterValueByName = Element.GetParameterValueByName(element=roof_level, parameterName=code_block_2)
code_block_3 = CodeBlock(roof_level=getParameterValueByName) { roof_thickness = 150; wall_height = roof_level - roof_thickness; }
explode = Geometry.Explode(geometry=offset)
byCurveAndHeight = Wall.ByCurveAndHeight(curve=explode, height=code_block_3.wall_height, level=groundfloor_level, wallType=wallType)

Output = Output(code_block_3.roof_thickness)  # ""
Wall = Output(byCurveAndHeight)
