# Dynamo graph 1_grids.dyn "1grids" (Dynamo 2.12.0.5650)
# packages: spring nodes 210.1.1

# group: secondary inputs
# note: your main floorplan view
views = Views("Ground Floor")
# note: external wall thicknesses
number = DoubleInput(300)
# note: select basement level
levels = Levels("Basement")
# note: floor type for basement, ground floor
floor_types = FloorTypes("150mm Foundation Slab")
# note: select roof level
levels_2 = Levels("Roof")
# note: floor type for roof
floor_types_2 = FloorTypes("150mm Foundation Slab")
# note: type for inner walls (200 mm)
wall_types = WallTypes("Generic - 200mm")
# note: type for basement walls (script assumes 300 mm)
wall_types_2 = WallTypes("Generic - 300mm")
# note: pick green roof floor type
floor_types_3 = FloorTypes("Green 150mm")

# group: primary inputs
# note: internal width
number_2 = DoubleInput(5050)
# note: internal lengths (spaces)
string = StringInput("4800,4800,9700,4000")
# note: internal wall thicknesses
string_2 = StringInput("200,200,100")
# note: has_green_roof
boolean = BoolSelector(true)

code_block = CodeBlock(in1=number_2, in2=string, in3=string_2, in4=number) { in1; in2; in3; in4; }

# group: Get building length and width
code_block_2 = CodeBlock { ","; }
split = String.Split(string=code_block.in3, separator0=code_block_2)
toNumber = String.ToNumber(string=split)
sum = Math.Sum(values=toNumber)
code_block_3 = CodeBlock { ","; }
split_2 = String.Split(string=code_block.in2, separator0=code_block_3)
toNumber_2 = String.ToNumber(string=split_2)
sum_2 = Math.Sum(values=toNumber_2)
code_block_4 = CodeBlock(extWallWidth=code_block.in4, intWallWidths=sum, roomWidths=sum_2) { totallength = 2 * extWallWidth + intWallWidths + roomWidths; }
# note: length
code_block_5 = CodeBlock(total=code_block_4) { Math.Ceiling(total / 1200) * 1200; }
code_block_6 = CodeBlock(extWallWidth=code_block.in4, intWidth=code_block.in1) { totalwidth = 2 * extWallWidth + intWidth; }
# note: width
code_block_7 = CodeBlock(total=code_block_6) { Math.Ceiling(total / 1200) * 1200; }

# group: baselines X direction
byCoordinates = Point.ByCoordinates()
XAxis = Vector.XAxis()
translate = Geometry.Translate(geometry=byCoordinates, direction=XAxis, distance=code_block_5)
byStartPointEndPoint = Line.ByStartPointEndPoint(startPoint=byCoordinates, endPoint=translate)

# group: gridlines X
YAxis = Vector.YAxis()
code_block_8 = CodeBlock(end=code_block_7) { 0; end; 1200; }
range = Range(start=code_block_8.out0, end=code_block_8.end, step=code_block_8.out2)
translate_2 = Geometry.Translate(geometry=byStartPointEndPoint, direction=YAxis, distance=range)

# group: baselines Y direction
byCoordinates_2 = Point.ByCoordinates()
YAxis_2 = Vector.YAxis()
translate_3 = Geometry.Translate(geometry=byCoordinates_2, direction=YAxis_2, distance=code_block_7)
byStartPointEndPoint_2 = Line.ByStartPointEndPoint(startPoint=byCoordinates_2, endPoint=translate_3)

# group: gridlines Y
XAxis_2 = Vector.XAxis()
code_block_9 = CodeBlock(end=code_block_5) { 0; end; 1200; }
range_2 = Range(start=code_block_9.out0, end=code_block_9.end, step=code_block_9.out2)
translate_4 = Geometry.Translate(geometry=byStartPointEndPoint_2, direction=XAxis_2, distance=range_2)

# group: create grid detail lines
byCurve = DetailCurve.ByCurve(view=views, curve=translate_2)
byCurve_2 = DetailCurve.ByCurve(view=views, curve=translate_4)

# group: create lines for the internal walls
code_block_10 = CodeBlock(baselines=byStartPointEndPoint_2) { baselines; }
XAxis_3 = Vector.XAxis()
code_block_11 = CodeBlock { -1; }
dropItems = List.DropItems(list=toNumber_2, amount=code_block_11)
code_block_12 = CodeBlock(intSpaceDims=dropItems, intWallDims=toNumber, extWallDim=code_block.in4) { intSpaceDims; intWallDims; extWallDim; }
python_script = Python(IN[0]=code_block_12.intSpaceDims, IN[1]=code_block_12.intWallDims, IN[2]=code_block.in4)  # IronPython2
# ---------- python_script.python (32 lines) ----------
# Load the Python Standard and DesignScript Libraries
import sys
import clr
clr.AddReference('ProtoGeometry')
from Autodesk.DesignScript.Geometry import *

# The inputs to this node will be stored as a list in the IN variables.
spaceDims = IN[0]
intWallDims = IN[1]
extWallDim = int(IN[2])
outlist = []

i = 0
nSpaces = len(spaceDims)
for spaceDim in spaceDims:
	iSpaceDim = int(spaceDim)
	nextIntWall = int(intWallDims[i])
	if i == 0:
		outlist.append(extWallDim + iSpaceDim + (nextIntWall / 2))
	elif i < nSpaces:
		previousVal = outlist[i-1]
		prevIntWall = int(intWallDims[i-1])
		outlist.append(previousVal + (prevIntWall / 2) + iSpaceDim + (nextIntWall / 2))
	i+=1
	
		
	

# Place your code below this line

# Assign your output to the OUT variable.
OUT = outlist
# ----------------------------------------
translate_5 = Geometry.Translate(geometry=code_block_10, direction=XAxis_3, distance=python_script)

# group: create grid lines
code_block_13 = CodeBlock { 2000; }
extendCurveStartEnd = Custom[ExtendCurveStartEnd](curve=translate_5, distance=code_block_13)
code_block_14 = CodeBlock(xlines=translate_2, ylines=translate_4) { lastx = xlines[-1]; lasty = ylines[-1]; [lastx,lasty]; }
code_block_15 = CodeBlock { 1000; }
extendCurveStartEnd_2 = Custom[ExtendCurveStartEnd](curve=code_block_14.out2, distance=code_block_15)
join = List.Join(list0=extendCurveStartEnd, list1=extendCurveStartEnd_2)
byLine = Grid.ByLine(line=join)  # frozen

# group: Get floor outline
code_block_16 = CodeBlock(firsty=byStartPointEndPoint_2, firstx=byStartPointEndPoint) { firsty; firstx; }
direction = Line.Direction(line=code_block_16.firsty)
translate_6 = Geometry.Translate(geometry=code_block_16.firstx, direction=direction)
direction_2 = Line.Direction(line=code_block_16.firstx)
translate_7 = Geometry.Translate(geometry=code_block_16.firsty, direction=direction_2)
code_block_17 = CodeBlock(a=code_block_16.firsty, b=code_block_16.firstx, c=translate_6, d=translate_7) { [a,b,c,d]; }
byJoinedCurves = PolyCurve.ByJoinedCurves(curves=code_block_17)
# note: facade panels should pass freely in front of floors. so floor edges are 150 mm inwards
code_block_18 = CodeBlock(ext_wall_thickness=number) { ext_wall_thickness / 2 * -1; }
offset = Curve.Offset(curve=byJoinedCurves, distance=code_block_18)

# group: create the ground floor and basement floor
code_block_19 = CodeBlock(floor_outline=byJoinedCurves) { floor_outline; }
ZAxis = Vector.ZAxis()
getGroundFloorLevel = Custom[GetGroundFloorLevel]()  # Returns the level which has elevation 0
code_block_20 = CodeBlock(groundfloor=getGroundFloorLevel, basement=levels) { groundfloor; basement; }
list_create = List.Create(item0=code_block_20.groundfloor, item1=code_block_20.basement)
elevation = Level.Elevation(level=list_create)
translate_8 = Geometry.Translate(geometry=code_block_19, direction=ZAxis, distance=elevation)
byOutlineTypeAndLevel = Floor.ByOutlineTypeAndLevel(outline=translate_8, floorType=floor_types, level=list_create, lacing=Longest)

# group: make sure wall curves align with floor edges
byPatch = Surface.ByPatch(closedCurve=offset)
intersect = Geometry.Intersect(geometry=byPatch, other=translate_5)
flatten = List.Flatten(list=intersect)
code_block_21 = CodeBlock(wall_curves=flatten) { wall_curves; }

# group: Build the inner walls on ground floor and basement
ZAxis_2 = Vector.ZAxis()
getGroundFloorLevel_2 = Custom[GetGroundFloorLevel]()
code_block_22 = CodeBlock(rooflevel=levels_2, groundfloorlevel=getGroundFloorLevel_2, basementlevel=levels) { rooflevel; groundfloorlevel; basementlevel; }
code_block_23 = CodeBlock { "Elevation"; }
getParameterValueByName = Element.GetParameterValueByName(element=code_block_22.groundfloorlevel, parameterName=code_block_23)
getParameterValueByName_2 = Element.GetParameterValueByName(element=code_block_22.basementlevel, parameterName=code_block_23)
list_create_2 = List.Create(item0=getParameterValueByName, item1=getParameterValueByName_2)
translate_9 = Geometry.Translate(geometry=code_block_21, direction=ZAxis_2, distance=list_create_2, lacing=CrossProduct)
getParameterValueByName_3 = Element.GetParameterValueByName(element=code_block_22.rooflevel, parameterName=code_block_23)
code_block_24 = CodeBlock(roof_slab_floor_type=floor_types_2) { roof_slab_floor_type; }
code_block_25 = CodeBlock { "Default Thickness"; }
getParameterValueByName_4 = Element.GetParameterValueByName(element=code_block_24, parameterName=code_block_25)
code_block_26 = CodeBlock(ground_floor_type=floor_types) { ground_floor_type; }
code_block_27 = CodeBlock { "Default Thickness"; }
getParameterValueByName_5 = Element.GetParameterValueByName(element=code_block_26, parameterName=code_block_27)
code_block_28 = CodeBlock(roof_level=getParameterValueByName_3, roof_thickness=getParameterValueByName_4, basement_level=getParameterValueByName_2, gf_thickness=getParameterValueByName_5)
# ---------- code_block_28.designscript (3 lines) ----------
gf_wall_height = roof_level - roof_thickness;
bs_wall_height = basement_level * -1 - gf_thickness;
[gf_wall_height, bs_wall_height];
# ----------------------------------------
count = List.Count(list=translate_9)
cycle = List.Cycle(list=code_block_28.out2, amount=count)
code_block_29 = CodeBlock(gf=code_block_22.groundfloorlevel, basement=code_block_22.basementlevel) { [gf, basement]; }
cycle_2 = List.Cycle(list=code_block_29, amount=count)
code_block_30 = CodeBlock(wallType=wall_types) { wallType; }

flatten_2 = List.Flatten(list=translate_9)
code_block_31 = CodeBlock(curves=flatten_2) { curves; }
code_block_32 = CodeBlock(heights=cycle) { heights; }
flatten_3 = List.Flatten(list=cycle_2)
code_block_33 = CodeBlock(levels=flatten_3) { levels; }
code_block_34 = CodeBlock(walltypes=code_block_30) { walltypes; }

# group (continued): Build the inner walls on ground floor and basement
byCurveAndHeight = Wall.ByCurveAndHeight(curve=code_block_31@L1, height=code_block_32, level=code_block_33@L1, wallType=code_block_34, lacing=Longest)

code_block_35 = CodeBlock(level=levels, walltype=wall_types_2) { level; walltype; }

# group: make the basement external walls
ZAxis_3 = Vector.ZAxis()
elevation_2 = Level.Elevation(level=levels)
translate_10 = Geometry.Translate(geometry=offset, direction=ZAxis_3, distance=elevation_2)
explode = Geometry.Explode(geometry=translate_10)
code_block_36 = CodeBlock(ground_floor_type=floor_types) { ground_floor_type; }
code_block_37 = CodeBlock { "Default Thickness"; }
getParameterValueByName_6 = Element.GetParameterValueByName(element=code_block_36, parameterName=code_block_37)
code_block_38 = CodeBlock(basement_level=elevation_2, gf_thickness=getParameterValueByName_6) { basement_level * -1 - gf_thickness; }
byCurveAndHeight_2 = Wall.ByCurveAndHeight(curve=explode, height=code_block_38, level=code_block_35.level, wallType=code_block_35.walltype)
code_block_39 = CodeBlock { "Base Offset"; }
code_block_40 = CodeBlock { 0; }
setParameterByName = Element.SetParameterByName(element=byCurveAndHeight_2, parameterName=code_block_39, value=code_block_40)
code_block_41 = CodeBlock { 250; 250; }

# group: create verharding around building
# note: A1 origin
byCoordinates_3 = Point.ByCoordinates()
rectangle_From_Point = Custom[Rectangle_From_Point](rect_width_x=code_block_5, rect_length_y=code_block_7, origin=byCoordinates_3)  # Rectangle with origin at given point. Length = x length. Width = y.
# note: Default contour offset
code_block_42 = CodeBlock { 1500; }
# note: outer curve
# note: inner curve
offset_2 = Curve.Offset(curve=rectangle_From_Point, distance=code_block_42)
floor_types_4 = FloorTypes("Concrete-Commercial 362mm")
getGroundFloorLevel_3 = Custom[GetGroundFloorLevel]()
byOutlineTypeAndLevel_2 = Floor.ByOutlineTypeAndLevel(outlineCurves=offset_2, floorType=floor_types_4, level=getGroundFloorLevel_3)
explode_2 = Geometry.Explode(geometry=rectangle_From_Point)
list_create_3 = List.Create(item0=explode_2)
ꟿ_opening_infloorbycurves = Custom[ꟿ Opening.InFloorByCurves](host=byOutlineTypeAndLevel_2, curves=list_create_3)  # package spring nodes; Create hosted floor opeinngs through the input floors. The second input is a list of sub-lists of the boundary curves.

code_block_43 = CodeBlock(floor_outline=offset, roof_level=levels_2, floor_type=floor_types_2, is_green_roof=boolean, building_length=code_block_5, building_width=code_block_7, green_roof_floor_type=floor_types_3) { floor_outline; roof_level; floor_type; is_green_roof; building_length; building_width; green_roof_floor_type; }

# group: ROOF SLAB (ALWAYS)
code_block_44 = CodeBlock(floor_outline=code_block_43.floor_outline, roof_level=code_block_43.roof_level, floor_type=code_block_43.floor_type, is_green_roof=code_block_43.is_green_roof) { floor_outline; roof_level; floor_type; is_green_roof; }
elevation_3 = Level.Elevation(level=code_block_44.roof_level)
XY_Plane_at_Z_level = Custom[XY_Plane_at_Z_level](Z_height=elevation_3)  # Creates an XY plane at the given Z height
pullOntoPlane = Curve.PullOntoPlane(curve=code_block_44.floor_outline, plane=XY_Plane_at_Z_level)
# note: the concrete roof slab
byOutlineTypeAndLevel_3 = Floor.ByOutlineTypeAndLevel(outline=pullOntoPlane, floorType=code_block_44.floor_type, level=code_block_44.roof_level, lacing=Longest)

# group: ROOF PANELS (OPTIONAL)
family_types = FamilyTypes("GM_Panel_Marco_Vermeulen:Closed")
code_block_45 = CodeBlock(green_roof=code_block_43.is_green_roof) { run = ! green_roof; }
byCoordinates_4 = Point.ByCoordinates()
code_block_46 = CodeBlock(roof_level=code_block_43.roof_level) { roof_level; }
elevation_4 = Level.Elevation(level=code_block_46)
code_block_47 = CodeBlock(a=elevation_4) { a + 150; }
XY_Plane_at_Z_level_2 = Custom[XY_Plane_at_Z_level](Z_height=code_block_47)
ꟿ_point_pullontoplane = Custom[ꟿ Point.PullOntoPlane](point=byCoordinates_4, plane=XY_Plane_at_Z_level_2)  # package spring nodes; Pulls (projects) the point onto the input plane, following the plane normal.
XAxis_4 = Vector.XAxis()
code_block_48 = CodeBlock { 600; }
translate_11 = Geometry.Translate(geometry=ꟿ_point_pullontoplane, direction=XAxis_4, distance=code_block_48)
XAxis_5 = Vector.XAxis()
code_block_49 = CodeBlock(building_length=code_block_43.building_length, building_width=code_block_43.building_width) { 0; building_length-1200; building_width-1200; 1200; }
# note: length
range_3 = Range(start=code_block_49.out0, end=code_block_49.out1, step=code_block_49.out3)
translate_12 = Geometry.Translate(geometry=translate_11, direction=XAxis_5, distance=range_3)
YAxis_3 = Vector.YAxis()
# note: width
range_4 = Range(start=code_block_49.out0, end=code_block_49.out2, step=code_block_49.out3)
# note: all tiles
translate_13 = Geometry.Translate(geometry=translate_12, direction=YAxis_3, distance=range_4, lacing=CrossProduct)
code_block_50 = CodeBlock(a=translate_12, b=translate_13) { List.Flatten([a,b]); }
YAxis_4 = Vector.YAxis()
code_block_51 = CodeBlock { 1200; }
translate_14 = Geometry.Translate(geometry=code_block_50, direction=YAxis_4, distance=code_block_51)
run = Custom[Run](run=code_block_45, stream=translate_14)  # Passes the stream if run==true, else returns null
byPoint = FamilyInstance.ByPoint(familyType=family_types, point=run)

# group: GREEN ROOF (OPTIONAL)
code_block_52 = CodeBlock(l=elevation_3) { l + 150; }
XY_Plane_at_Z_level_3 = Custom[XY_Plane_at_Z_level](Z_height=code_block_52)
pullOntoPlane_2 = Curve.PullOntoPlane(curve=code_block_44.floor_outline, plane=XY_Plane_at_Z_level_3)
run_2 = Custom[Run](run=code_block_44.is_green_roof, stream=code_block_43.green_roof_floor_type)
# note: the green roof
byOutlineTypeAndLevel_4 = Floor.ByOutlineTypeAndLevel(outline=pullOntoPlane_2, floorType=run_2, level=code_block_44.roof_level, lacing=Longest)
