# Dynamo graph 2_facade.dyn (Dynamo 2.12.0.5650)
# packages: Sastrugi 2.0.2

# note: re-trigger point placement
boolean = BoolSelector(false)
pick_points_on_workplane = Custom[❄_Pick Points on Workplane](Reset=boolean)  # package Sastrugi; (Sastrugi_Selection) This node allows users to pick points in Revit on the Active Workplane.
# note: is open facade
boolean_2 = BoolSelector(true)

# group: default inputs (only change if revit template is not working)
# note: the roof level
levels = Levels("Roof")
# note: the ground floor level
levels_2 = Levels("Ground Floor")
# note: the column type foor open facade
# script assumes 150 x 50
family_types = FamilyTypes("M_Rectangular Column:150 x 50mm")
# note: the facade inner concrete wall type
# script assumes 150
wall_types = WallTypes("Generic - 150mm")

OS_FacadeSection = Custom[OS_FacadeSection](picked_points=pick_points_on_workplane.RevitPoints, is_open_facade=boolean_2, roof_level=levels, groundfloor_level=levels_2, columntype_openfacade=family_types, waltype_closedfacade=wall_types)
