# Dynamo graph 3_doors.dyn "3_doors_working" (Dynamo 2.12.0.5650)

boolean = BoolSelector(false)
# note: the main floor plan with the gridlines
views = Views("Ground Floor")
boolean_2 = BoolSelector(false)
# note: door height
number = DoubleInput(2950)
OS_PlaceDoor = Custom[OS_PlaceDoor](trigger_placement_point=boolean, gridlines_view=views, is_double_door=boolean_2, door_height=number)
boolean_3 = BoolSelector(true)
boolean_4 = BoolSelector(false)
OS_PlaceDoor_2 = Custom[OS_PlaceDoor](trigger_placement_point=boolean_3, gridlines_view=views, is_double_door=boolean_4, door_height=number)
