# Dynamo graph 4_panel_rotation.dyn "panel_rotation" (Dynamo 2.12.0.5650)

family_types = FamilyTypes("GM_Panel_Marco_Vermeulen:Closed")
byFamilyType = FamilyInstance.ByFamilyType(familyType=family_types)
family_types_2 = FamilyTypes("GM_Panel_Marco_Vermeulen:Rooster")
byFamilyType_2 = FamilyInstance.ByFamilyType(familyType=family_types_2)
code_block = CodeBlock(a=byFamilyType, b=byFamilyType_2) { List.Flatten([a,b]); }
code_block_2 = CodeBlock { "panel_rotation"; }
# note: create a random rotation value per element
python_script = Python(IN[0]=code_block)  # IronPython2
# ---------- python_script.python (10 lines) ----------
import random

inlist = IN[0]
choices = [0,90,180,270]
outlist = []

for i in inlist:
	outlist.append(random.choice(choices))

OUT = outlist
# ----------------------------------------
setParameterByName = Element.SetParameterByName(element=code_block, parameterName=code_block_2, value=python_script)
